# Dynamo graph summon_DimensionPipeToClosestGridLines.dyn "summon_DimensionPipeToClosestGrids" (Dynamo 2.3.0.5885)

# group: DESIGN
# note: DESIGN
# note: USE:
# FOR THE BACK-END FUNCTIONALITY

# group: <PROJECT NO.> <PROJECT NAME>
# note: CREATED BY: <SUMMONIDEA>
# CREATED: <20210519>
# VERSION <0.1>
# LAST EDITED: <XXXXYYZZ>
# DYNAMO VERSION: <Dynamo 2.3>
# PACKAGES:
# <PACKAGES>
# NOTES:
# <NOTES>
# DYNAMO GRAPHIC STANDARD
# CREATED BY: VLADIMIR ONDEJCIK
# WHITE ARKITEKTER AB - 2016

# group: DESIGNER'S GUIDELINES
# note: DESIGNER'S GUIDELINES
# 1. DIVIDE THE DYNAMO DEFINITION INTO THE USER INTERFACE AND THE BACK-END
# 2. BUILD THE DEFINITION WITH SMALL BLOCKS
# 3. BLOCKS SHOULD ALWAYS HAVE INPUT/OUTPUT
# 4. RENAME INPUT/OUTPUT CONTAINERS TO DATA THEY CARRY
# 5. COLOR-CODE BLOCKS ACCORDING TO THE TEMPLATE

# group: USER INTERFACE
# note: INPUT + CONTROL

# group: DESIGN
# note: BACK-END FUNCTIONALITY

# group: CONTROL
# note: CONTROL
# note: USE:
# FOR THE USER INPUT (SUCH AS SLIDERS,
#  NUMBERS, ....)

# group: INPUT
# note: INPUT
# note: USE:
# FOR THE INCOMMING REFFERENCES
# (FILE PATHS, GEOMETRIES ...                     )

# group: TO REVIT
# note: TO REVIT
# note: USE:
# FOR BLOCKS THAT EXPORT THE GEOMETRY AND PARAMETERS TO REVIT

# group: MONITOR
# note: MONITOR
# note: USE:
# FOR IMPORTANT WATCH NODES

# group: ANNOTATION
# note: ANNOTATION
# note: USE:
# FOR COMMENTS

# group: WIP
# note: WIP
# note: USE:
# FOR "WORK IN PROGRESS"

# group: CONTROL
element_types = ElementTypes("Level")
select_view = Views("1 - Plumbing")  # graph input
select_model_elements = DSModelElementsSelection()  # 7 picked in the model; graph input
category_of_elements_to = Categories("OST_PipeCurves")  # "Category of Elements to Dimension"; graph input
categories = Categories("OST_Grids")
dimension_offset = DoubleSlider(-2, range=-3..3 step 0.5)  # graph input

# group: WIP - Get elevation of level associated to view
all_elements_of_type = ElementsOfType(element_type=element_types)
name = Element.Name(element=all_elements_of_type)
code_block = CodeBlock(view=select_view) { level = View.GetParameterValueByName(view, "Associated Level"); }
contains = String.Contains(str=name, searchFor=code_block)
filterByBoolMask = List.FilterByBoolMask(list=all_elements_of_type, mask=contains)
elevation = Level.Elevation(level=filterByBoolMask.in)
byCoordinates = Point.ByCoordinates(z=elevation)
ZAxis = Vector.ZAxis()
byOriginNormal = Plane.ByOriginNormal(origin=byCoordinates, normal=ZAxis)

getCategory = Element.GetCategory(element=select_model_elements)

# group: Filter Elements of the category selected (Pipes)
string_from_object = FromObject(obj=getCategory)
string_from_object_2 = FromObject(obj=category_of_elements_to)
eq = string_from_object == string_from_object_2
filterByBoolMask_2 = List.FilterByBoolMask(list=select_model_elements, mask=eq)

# group: Setting up list of model elements to pair with Grids
code_block_2 = CodeBlock { 2; }
ofRepeatedItem = List.OfRepeatedItem(item=filterByBoolMask_2.in@L1, amount=code_block_2)
flatten = List.Flatten(list=ofRepeatedItem)

all_elements_of_category = ElementsOfCategory(Category=categories)
curve = Grid.Curve(grid=all_elements_of_category)

# group: Intersecting Grid lines against grid lines
intersect = Geometry.Intersect(geometry=curve, other=curve, lacing=CrossProduct)

flatten_2 = List.Flatten(list=intersect)

# group: Filter only points that make up grid intersections
type = Object.Type(obj=flatten_2)
code_block_3 = CodeBlock { "Point"; }
contains_2 = String.Contains(str=type, searchFor=code_block_3)
filterByBoolMask_3 = List.FilterByBoolMask(list=flatten_2, mask=contains_2)

# group: Purge duplicated points
code_block_4 = CodeBlock { 0.1; }
pruneDuplicates = Point.PruneDuplicates(points=filterByBoolMask_3.in, tolerance=code_block_4)

# group: Get Element location/geometry
getLocation = Element.GetLocation(element=filterByBoolMask_2.in)
startPoint = Curve.StartPoint(curve=getLocation)
endPoint = Curve.EndPoint(curve=getLocation)
pick_closer_to_level = Python(IN[0]=startPoint, IN[1]=endPoint)
# ---------- pick_closer_to_level.python (15 lines) ----------
# Load the Python Standard and DesignScript Libraries
import sys
import clr
clr.AddReference('ProtoGeometry')
from Autodesk.DesignScript.Geometry import *

# The inputs to this node will be stored as a list in the IN variables.
p0 = IN[0]
p1 = IN[1]

# Place your code below this line
for i in range(len(p0)):
	True
# Assign your output to the OUT variable.
OUT = p1
# ----------------------------------------
X = Point.X(point=pick_closer_to_level)
Y = Point.Y(point=pick_closer_to_level)
byCoordinates_2 = Point.ByCoordinates(x=X, y=Y)

# group: Find the closest Grid intersection to each model element in the selection (Pipes)
distanceTo = Geometry.DistanceTo(geometry=pruneDuplicates, other=byCoordinates_2@L1)
minimumItem = List.MinimumItem(list=distanceTo)
indexOf = List.IndexOf(list=distanceTo@L2, element=minimumItem@L1)
getItemAtIndex = List.GetItemAtIndex(list=pruneDuplicates, index=indexOf)

# group: Get the corresponding pair of Grids that make up for the closest intersection to model elements(Pipes)
doesIntersect = Geometry.DoesIntersect(geometry=getItemAtIndex@L1, other=curve@L2, lacing=Longest)
filterByBoolMask_4 = List.FilterByBoolMask(list=all_elements_of_category, mask=doesIntersect@L2)

# group: Pair of grids closest to pipe
watch = Watch(filterByBoolMask_4.in)

flatten_3 = List.Flatten(list=watch)

# group: Combining Grids and model elements (Pipes)
list_create = List.Create(item0=flatten, item1=flatten_3)
transpose = List.Transpose(lists=list_create)

# group: Pair of elements to dimension
watch_2 = Watch(transpose)

curve_2 = Grid.Curve(grid=watch)

# group: Find the closest point from the model element (Pipes) to the pair the Grids
closestPointTo = Geometry.ClosestPointTo(geometry=curve_2, other=byCoordinates_2)

# group: Creating the line from model element (Pipe) to Grid line to position Dimension Line
byStartPointEndPoint = Line.ByStartPointEndPoint(startPoint=byCoordinates_2, endPoint=closestPointTo)
flatten_4 = List.Flatten(list=byStartPointEndPoint)
offset = Curve.Offset(curve=flatten_4, distance=dimension_offset)
startPoint_2 = Curve.StartPoint(curve=offset)
endPoint_2 = Curve.EndPoint(curve=offset)
byStartPointEndPoint_2 = Line.ByStartPointEndPoint(startPoint=startPoint_2, endPoint=endPoint_2)

# group: Dimension to Revit
byElements = Dimension.ByElements(view=select_view, referenceElements=watch_2@L2, line=byStartPointEndPoint_2@L1)
